# Grasshopper definition Automated_AI_export_DSub_v10.gh (Grasshopper 0.9.76)

# [Aytomated AI Export] was written by Marios Tsiliakos on 06/11/2014 in grasshopper 0.9.0076
# This definition is for the pubic domain feel free to use it , share it and modify it, by providing proper citing. The author, Marios Tsiliakos of digitalsubstance.wordpress.com , makes no warranty, expressed or implied, as to the usefulness of the software and documentation for any purpose. If this tool is used for commercial purposes please notify the author. This work is licensed under a Creative Commons Attribution-Share Alike 3.0
# for more information visit digitalsubstance.wordpress.com.
frames = Panel("20")

# ---- group: toggle this
toggle = BooleanToggle(False)

# ----
timer = Timer(TimerInterval=50, Target=c_script)  # disabled
c_script = CSharpScript(Framecount=frames, Run=toggle)  # -> out, Count, Trigger, Parameter; inputs Framecount: Int32, Run: Boolean
# ---------- c_script: C# ----------
    if(Run){
      counter++;
    }else{
      trig = false;
      counter = 0;
    }

    if(counter >= 0 && counter <= Framecount && Run == true){
      trig = true;
    }else{
      trig = false;
      Print("Done");
      return;
    }

    Count = counter;
    Trigger = trig;
    Parameter = (float) counter / Framecount;
# ---------- c_script: C# additional code ----------
  private int counter = 0;
  private bool trig = false;
# ---------- end c_script ----------
panel = Panel(c_script.out)
panel_2 = Panel(c_script.Count)
bool = Boolean(c_script.Trigger)
num = Number(c_script.Parameter)
panel_3 = Panel(c_script.Parameter)
int = Integer(c_script.Count)
panel_4 = Panel(c_script.Trigger)
cir = Circle(Plane=PlaneXY(0, 0, 0), Radius=10)
random = Random(Range=Domain(0, 1), Number=Slider(40, range=0..100), Seed=Slider(26, range=0..100))
eval = EvaluateCurve(Curve=reparameterize(cir), Parameter=random)  # -> Point, Tangent, Angle
jitter = Jitter(List=eval.Point, Jitter=1, Seed=2)  # -> Values, Indices
path_mapper = PathMapper(jitter.Values, source="{A;B;C}(i)", target="{A;B;C;i\2}")

# ---- group: run the routine
toggle_2 = BooleanToggle(True)

# ----
pline = PolyLine(Vertices=path_mapper, Closed=False)  # -> flatten(Polyline)
item = ListItem(List=pline, Index=int, Wrap=True)
crv = Curve([item, cir])

diectory_to_create = Panel("C:\Ai_exports\")
rhino_layer_to_bake_the_curves_to = Panel("export_layer")
ai_file_name = Panel("testV01")

c_script_2 = CSharpScript(
    curves=crv,
    series=int,
    name=ai_file_name,
    layername=rhino_layer_to_bake_the_curves_to,
    filepath=diectory_to_create,
    execute=toggle_2)  # -> out; inputs curves: list of Curve, series: Int32, name: String, layername: String, filepath: String, execute: Boolean
# ---------- c_script_2: C# ----------
    #region Authorship
    //[Aytomated AI Export] was written by Marios Tsiliakos on 06 / 11 / 2014 in grasshopper 0.9.0076
    //This definition is for the pubic domain feel free to use it , share it and modify it, by providing proper citing. The author, Marios Tsiliakos of digitalsubstance.wordpress.com , makes no warranty, expressed or implied, as to the usefulness of the software and documentation for any purpose.If this tool is used for commercial purposes please notify the author. This work is licensed under a Creative Commons Attribution-Share Alike 3.0
    //for more information visit digitalsubstance.wordpress.com.
    #endregion

    if (!execute)return;

    else
    {
      //check
      for (int i = 0; i < curves.Count;i++){
        if ((curves.Count == 0) || (curves[i] == null))
        {
          Print("No curves or valid curves provided");
          return;
        }
      }
      //create alist of guids
      List<Guid> mycurves = new List<Guid>();
      // layer to bake the objects to
      create_layer(layername);
      //create a directory to store the ai files
      create_dir(filepath);

      for(int i = 0; i < curves.Count; i++){
        //declare the objects attributes
        Rhino.DocObjects.ObjectAttributes attr = new Rhino.DocObjects.ObjectAttributes();
        //set attributes
        attr.LayerIndex = doc.Layers.Find(layername, true);

        Guid id = Guid.Empty;

        //bake the curves
        if(curves[i].ObjectType == Rhino.DocObjects.ObjectType.Curve)
        {
          id = doc.Objects.AddCurve((Curve) curves[i], attr);
        }

        // add the curves to the mycurve_guid list
        if(id.ToString().Length > 0) mycurves.Add(id);
      }
      // select the curves in Rhino to successfully export them
      for(int i = 0; i < mycurves.Count; i++)
      {
        doc.Objects.Select(mycurves[i], true);
      }
      //where to save
      string save_directory = filepath + ("\\" + name) + series.ToString("0000") + ".ai";
      //and export them
      Rhino.RhinoApp.RunScript("-_Export\n\"" + save_directory + "\"\n _Enter", false);
      //delete the curves after exporting them
      for(int i = 0; i < mycurves.Count; i++) doc.Objects.Delete(mycurves[i], true);
    }
# ---------- c_script_2: C# additional code ----------
 /// <summary>new random number.</summary>
  private readonly Random rand = new Random();
  /// <summary>check if the specified layer exists and if not crete it.</summary>
  private void create_layer(string l)
  {
    int layerslist = doc.Layers.Find(l, true);

    if(layerslist < 0){
      Rhino.DocObjects.Layer l0 = new Rhino.DocObjects.Layer();
      System.Drawing.Color m_color = RandomColour();
      l0.Color = m_color;
      l0.Name = l;
      layerslist = doc.Layers.Add(l0);
    }
  }
  /// <summary>assign new random color</summary>
  private Color RandomColour()
  {
    return Color.FromArgb(this.rand.Next(256), this.rand.Next(256), this.rand.Next(256));
  }
  /// <summary>create a new directory in your system</summary>
  public void create_dir(string path)
  {
    string directoryName = Path.GetDirectoryName(path);
    if ((directoryName.Length > 0) && (!Directory.Exists(directoryName)))
    {
      Directory.CreateDirectory(directoryName);
    }
  }
# ---------- end c_script_2 ----------

runtime_errors = Panel(c_script_2)
